# Grasshopper definition sightline.gh (Grasshopper 1.0.7)

number_slider = Slider(4, range=0..100)
height = Slider(100, range=0..100)
depth = Slider(28, range=0..1000)
angle = Slider(45, range=0..90)
width = Slider(6, range=1..20)
number_slider_2 = Slider(13, range=0..100)
height_2 = Slider(100, range=0..100)
depth_2 = Slider(28, range=0..1000)
angle_2 = Slider(45, range=0..90)
height_3 = Slider(45, range=0..100)
width_2 = Slider(6, range=1..20)
addition = Addition(A=Slider(16, range=0..100), B=number_slider)
addition_2 = Addition(A=Slider(7, range=0..100), B=number_slider_2)
subtraction = Subtraction(A=addition, B="1")
subtraction_2 = Subtraction(A=addition_2, B="1")
subtraction_3 = Subtraction(A="180", B=angle)
subtraction_4 = Subtraction(A="180", B=angle_2)
series = Series(Start=depth, Step=depth, Count=addition)
series_2 = Series(Start=depth_2, Step=depth_2, Count=addition_2)
range = Range(Domain=Domain(0, 1), Steps=subtraction)
range_2 = Range(Domain=Domain(0, 1), Steps=subtraction_2)
graph = GraphMapper(range, x0=0, x1=1, y0=0, y1=1, Cx=0.5072463751, Cy=0.4927536249, container_name="Conic")
rad = Radians(Degrees=angle)
rad_2 = Radians(Degrees=subtraction_3)
graph_2 = GraphMapper(range_2, x0=0, x1=1, y0=0, y1=1, Cx=0.5072463751, Cy=0.4927536249, container_name="Conic")
rad_3 = Radians(Degrees=angle_2)
rad_4 = Radians(Degrees=subtraction_4)
dom = ConstructDomain(DomainStart=rad, DomainEnd=rad_2)
arc = Arc(Plane=PlaneXY(0, 0, 0), Radius=series, Angle=dom)  # -> Arc, Length
dom_2 = ConstructDomain(DomainStart=rad_3, DomainEnd=rad_4)
arc_2 = Arc(Plane=PlaneXY(0, 0, 0), Radius=series_2, Angle=dom_2)  # -> Arc, Length
multiplication = Multiplication(A=graph, B=height)
multiplication_2 = Multiplication(A=graph_2, B=height_2)
Z = UnitZ(Factor=multiplication)
addition_3 = Addition(A=multiplication_2, B=height_3)
Z_2 = UnitZ(Factor=addition_3)
move = Move(Geometry=arc.Arc, Motion=Z)  # -> Geometry, Transform
move_2 = Move(Geometry=arc_2.Arc, Motion=Z_2)  # -> Geometry, Transform
shift = ShiftList(List=move.Geometry, Shift=number_slider, Wrap=False)
len = Length(Curve=shift)
division = Division(A=len, B=width)
shift_2 = ShiftList(List=move_2.Geometry, Shift=number_slider_2, Wrap=False)
len_2 = Length(Curve=shift_2)
division_2 = Division(A=len_2, B=width_2)
round = Round(Number=division)  # -> Nearest, Floor, Ceiling
round_2 = Round(Number=division_2)  # -> Nearest, Floor, Ceiling
divide = DivideCurve(Curve=shift, Count=round.Floor, Kinks=False)  # -> simplify(Points), Tangents, Parameters
divide_2 = DivideCurve(Curve=shift_2, Count=round_2.Floor, Kinks=False)  # -> Points, Tangents, Parameters
viewer = ParamViewer(divide_2.Points)
viewer_2 = ParamViewer(divide.Points)
lng = ListLength(List=viewer)
lng_2 = ListLength(List=divide_2.Points)
lng_3 = ListLength(List=viewer_2)
lng_4 = ListLength(List=divide.Points)
series_3 = Series(Start="1", Step=1, Count=lng)
series_4 = Series(Start="1", Step=1, Count=lng_3)
dup = DuplicateData(Data=simplify(graft(series_3)), Number=lng_2, Order=True)
dup_2 = DuplicateData(Data=simplify(graft(series_4)), Number=lng_4, Order=True)
target = Panel("0,0,0")
radius = Panel("2")
entwine = Entwine(Branch00=flatten(divide.Points), Branch01=flatten(divide_2.Points), FlattenInputs=True)
entwine_2 = Entwine(Branch00=flatten(dup_2), Branch01=flatten(dup), FlattenInputs=True)
c_script = CSharpScript(points=entwine, target=target, radius=radius)  # -> out, Results; inputs points: list of Point3d, target: Point3d, radius: Double
# ---------- c_script: C# ----------
    var oResults = new List<int>();
    List<Sphere> TestSpheres = new List<Sphere>();
    for(int i = 0; i < points.Count;i++)
    {
      TestSpheres.Clear();
      for(int j = 0;j < points.Count;j++)
      {
        if(i != j){TestSpheres.Add(new Sphere(points[j], radius));}
      }
      var res = CheckSightLine(points[i], TestSpheres, target);
      oResults.Add(res);
    }
    Results = oResults;
# ---------- c_script: C# additional code ----------
  public int CheckSightLine(Point3d pt, List<Sphere> TestSpheres, Point3d target)
  {
    var count = 0;
    var l = new Line(pt, target);
    Point3d pt1;
    Point3d pt2;
    for (int i = 0;i < TestSpheres.Count;i++)
    {
      var events = Rhino.Geometry.Intersect.Intersection.LineSphere(l, TestSpheres[i], out pt1, out pt2);
      if (events != Rhino.Geometry.Intersect.LineSphereIntersection.None){count += 1;}
    }
    return count;
  }


  /// <summary>
  /// This method will be called once every solution, before any calls to RunScript.
  /// </summary>
  /// <summary>
  /// This method will be called once every solution, after any calls to RunScript.
  /// </summary>
# ---------- end c_script ----------
sort = SortList(Keys=c_script.Results)  # -> Keys, ValuesA
panel = Panel(c_script.Results)
item = ListItem(List=sort.Keys, Index=0, Wrap=True)  # -> Item1, Item
ln = Line(StartPoint=entwine, EndPoint=target)
gradient = Gradient(
    LowerLimit=item.Item1,
    UpperLimit=item.Item,
    Parameter=c_script.Results,
    stops=[0: RGB(234, 38, 0), 0.25: RGB(234, 126, 0), 0.5: RGB(254, 244, 84), 0.75: RGB(173, 203, 249), 1: RGB(75, 107, 169)])
panel_2 = Panel("""first_floor
second_floor
first_floor_x
second_floor_x""")
python = GhPythonScript(export=Toggle(False), data=simplify(panel), keys=panel_2, x=simplify(entwine_2))  # -> out, a; inputs export: Boolean, data: tree of Int32, keys: list, x: tree
# ---------- python: Python ----------
from ghpythonlib import treehelpers as th
import os, json

_data = th.tree_to_list(data,0)
_dict = {}

_x = th.tree_to_list(x, 0)

for i,d in enumerate(_data):
     _dict[keys[i]] = d

for i,d in enumerate(_x):
     _dict[keys[i+2]] = d

if export:
    dir = os.path.dirname(ghdoc.Path)
    with open('{}/data.json'.format(dir), 'w') as fp:
        json.dump(_dict, fp)
# ---------- end python ----------
preview = CustomPreview(Geometry=ln, Material=gradient)
preview_2 = CustomPreview(Geometry=entwine, Material=gradient)
preview_3 = CustomPreview(Geometry=target, Material=ColourSwatch(SwatchColor=RGB(255, 255, 255)))
